# Dynamo custom node RIE.AllRelatedFamilyTypes.dyf (Dynamo 1.3.3.4651)
# category: RIE.Elements
# Input a family type, and get all the family types that belongs to the family.

familyType = Input(familyType : FamilyType)
family = FamilyType.Family(familyType)
LinkOptional = Input(LinkOptional : var = null)
linkDocFromLink = Custom[RIE.LinkDocFromLink](LinkInstance=LinkOptional)  # Retrieves link Document element from link element.
python_script = Python(IN[0]=family, IN[1]=linkDocFromLink)
# ---------- python_script.python (41 lines) ----------
# BORROWED FROM MEPOver Package by TPover (Fanily types of family)

import clr
clr.AddReference('ProtoGeometry')
from Autodesk.DesignScript.Geometry import *

# Import DocumentManager and TransactionManager
clr.AddReference("RevitServices")
import RevitServices
from RevitServices.Persistence import DocumentManager

if IN[1] != None:
	doc = UnwrapElement(IN[1])
else:
	doc = DocumentManager.Instance.CurrentDBDocument

#The inputs to this node will be stored as a list in the IN variables.
if isinstance(IN[0], list):
	toggle = 0
	family = UnwrapElement(IN[0])
else:
	toggle = 1
	family = [UnwrapElement(IN[0])]

listout = []
for fam in family:
	ids = fam.GetFamilySymbolIds()
	types = []
	for i in ids:
		type = doc.GetElement(i)
		types.append(type)
	listout.append(types)

#Assign your output to the OUT variable.
if toggle == 0:
	OUT = listout
else:
	OUT = types

if len(OUT) == 1:
	OUT = OUT[0]
# ----------------------------------------
familyType_2 = Output(python_script)  # "familyType"
