# Dynamo custom node RIE.BBox.StretchZ.dyf (Dynamo 1.3.4.6666)
# category: RIE.Geometry
# Stretch the boundingbox in Z directions.

BBox = Input(BBox : BoundingBox)
minPoint = BoundingBox.MinPoint(BBox)
deconstructPoint = Custom[RIE.DeconstructPoint](Point=minPoint)  # Deconstructs points into their X, Y and Z values. Idea stolen from Lunchbox's equivalent node.
DownAmount = Input(DownAmount : double = 0)
sub = deconstructPoint.Z - DownAmount
byCoordinates = Point.ByCoordinates(x=deconstructPoint.X, y=deconstructPoint.Y, z=sub)
maxPoint = BoundingBox.MaxPoint(BBox)
deconstructPoint_2 = Custom[RIE.DeconstructPoint](Point=maxPoint)
UpAmount = Input(UpAmount : double = 0)
add = deconstructPoint_2.Z + UpAmount
byCoordinates_2 = Point.ByCoordinates(x=deconstructPoint_2.X, y=deconstructPoint_2.Y, z=add)
byCorners = BoundingBox.ByCorners(min=byCoordinates, max=byCoordinates_2)
BBox_2 = Output(byCorners)  # "BBox"
