# Dynamo custom node RIE.BBoxByElements.dyf (Dynamo 1.3.4.6666)
# category: RIE.Elements
# Creates a boundingbox from a set of elements

elements = Input(elements : Element)
boundingBox = Element.BoundingBox(elements)
minPoint = BoundingBox.MinPoint(boundingBox)
maxPoint = BoundingBox.MaxPoint(boundingBox)
join = List.Join(minPoint, maxPoint)
isNull = Object.IsNull(join)
filterByBoolMask = List.FilterByBoolMask(list=join, mask=isNull)
byGeometry = BoundingBox.ByGeometry(filterByBoolMask.out)
BBox = Output(byGeometry)
