# Dynamo custom node RIE.BatchIFC.dyf (Dynamo 1.3.3.4651)
# category: RIE.Export
# Forked from Bakery. Modified to work with view inputs.
# Input directory path and 3D view prefix.

Directory = Input()
current = Document.Current()
filePath = Document.FilePath(current)
fileName = FilePath.FileName(filePath)
string = StringInput(".")
split = String.Split(fileName, string)
watch = Watch(split)
number = DoubleInput(0)
getItemAtIndex = List.GetItemAtIndex(list=watch, index=number)
string_2 = StringInput("_")
add = getItemAtIndex + string_2  # lacing=Longest
categories = Categories("Views")
all_elements_of_category = ElementsOfCategory(categories)
remove_nulls = Python(IN[0]=all_elements_of_category)
# ---------- remove_nulls.python (23 lines) ----------
# Copyright (c) 2014, Nathan Miller
# The Proving Ground, http://TheProvingGround.org

# Default imports
import clr
clr.AddReference('ProtoGeometry')
from Autodesk.DesignScript.Geometry import *

#The input to this node will be stored in the IN[0] variable.
list = IN[0]

cleanlist = []
for i in list:
	if hasattr(i, "__iter__"):
		for ii in i:
			if not (i is None):
				cleanlist.append(i)	
	else:
		if not (i is None):
			cleanlist.append(i)	

#Assign your output to the OUT variable
OUT = cleanlist
# ----------------------------------------
name = Element.Name(remove_nulls)
create = List.Create(name)
string_from_object = FromObject(create)
ViewNamePrefix = Input()
startsWith = String.StartsWith(str=string_from_object, searchFor=ViewNamePrefix)
filterByBoolMask = List.FilterByBoolMask(list=create, mask=startsWith)
create_2 = List.Create(filterByBoolMask.in)
flatten = Flatten(create_2)
add_2 = add + flatten  # lacing=Longest
IFCversion = Input(IFCversion : string = "IFC2x3")
boolean = BoolSelector(false)
boolean_2 = BoolSelector(true)
flatten_2 = Flatten(startsWith)
filterByBoolMask_2 = List.FilterByBoolMask(list=remove_nulls, mask=flatten_2)
PsetFP = Input(PsetFP : string = null)
python_script = Python(IN[0]=Directory, IN[1]=add_2, IN[2]=IFCversion, IN[3]=boolean, IN[4]=boolean_2, IN[5]=filterByBoolMask_2.in, IN[6]=PsetFP)
# ---------- python_script.python (84 lines) ----------
import clr
clr.AddReference('ProtoGeometry')
from Autodesk.DesignScript.Geometry import *
# Import ToDSType(bool) extension method
clr.AddReference("RevitNodes")
import Revit
clr.ImportExtensions(Revit.Elements)
# Import geometry conversion extension methods
clr.ImportExtensions(Revit.GeometryConversion)
# Import DocumentManager and TransactionManager
clr.AddReference("RevitServices")
import RevitServices
from RevitServices.Persistence import DocumentManager
from RevitServices.Transactions import TransactionManager
from System.Collections.Generic import *
# Import RevitAPI
clr.AddReference("RevitAPI")
import Autodesk
from Autodesk.Revit.DB import *

doc = DocumentManager.Instance.CurrentDBDocument
uiapp = DocumentManager.Instance.CurrentUIApplication
app = uiapp.Application
uidoc=DocumentManager.Instance.CurrentUIApplication.ActiveUIDocument

#The inputs to this node will be stored as a list in the IN variable.
#dataEnteringNode = IN

folder=UnwrapElement(IN[0])
name=UnwrapElement(IN[1])
fileversion = IN[2]
wallandcolumnsplitting = IN[3]
exportbasequantities = IN[4]
view = UnwrapElement(IN[5])


#IFCVersion=UnwrapElement(IN[2])

# Start Transaction
TransactionManager.Instance.EnsureInTransaction(doc)
total_export = []

for i,v in enumerate(view):
	options=IFCExportOptions()
	
	#if fileversion != None:
	#	options.FileVersion = fileversion
	if fileversion == "IFC4":
		options.FileVersion = IFCVersion.IFC4
	if fileversion == "IFC2x2":
		options.FileVersion = IFCVersion.IFC2x2
	if fileversion == "IFC2x3":
		options.FileVersion = IFCVersion.IFC2x3
	if fileversion == "IFC2x3":
		options.FileVersion = IFCVersion.IFC2x3CV2
	if fileversion == "IFCBCA":
		options.FileVersion = IFCVersion.IFCBCA
	if fileversion == "IFCCOBIE":
		options.FileVersion = IFCVersion.IFCCOBIE
	if fileversion == "":
		options.FileVersion = IFCVersion.Default
		
		
	options.WallAndColumnSplitting = wallandcolumnsplitting
	options.ExportBaseQuantities = exportbasequantities
	options.FilterViewId = v.Id
	options.AddOption("ExportUserDefinedPsets","true") 
	if IN[6] != None:
		options.AddOption("ExportUserDefinedPsetsFileName",IN[6])


#IFCVersion Version = (IFCVersion) Enum.Parse( typeof(IFCVersion), UnwrapElement(IN[2]), true );
#x.FileVersion = IFCVersion.IFC2x3CV2

	c=doc.Export(folder, name[i], options)
	total_export.append(c)

# End Transaction
TransactionManager.Instance.TransactionTaskDone()

if fileversion == "":
	OUT="Default settings used"
else:
	OUT=total_export
# ----------------------------------------
Success = Output(python_script)  # "Success?"
