# Dynamo custom node RIE.BoundingBoxBy3DView.dyf (Dynamo 1.3.2.2480)
# category: RIE.Geometry
# Outputs the boundingbox of input 3D view

n3D_View = Input(3D View)
python_script = Python(IN[0]=n3D_View)
# ---------- python_script.python (56 lines) ----------
import clr
clr.AddReference('ProtoGeometry')
from Autodesk.DesignScript.Geometry import *

# Import ToDSType(bool) extension method
clr.AddReference("RevitNodes")
import Revit
clr.ImportExtensions(Revit.Elements)

# Import DocumentManager and TransactionManager
clr.AddReference("RevitServices")
import RevitServices
from RevitServices.Persistence import DocumentManager
from RevitServices.Transactions import TransactionManager

from System.Collections.Generic import *

# Import RevitAPI
clr.AddReference("RevitAPI")
import Autodesk
from Autodesk.Revit.DB import ReferencePointArray

doc = DocumentManager.Instance.CurrentDBDocument
uiapp = DocumentManager.Instance.CurrentUIApplication
app = uiapp.Application

def tolist(obj):
	if isinstance(obj, list):
		return UnwrapElement(obj)
	else:
		return [UnwrapElement(obj)]

#unwrap all elements to use with API
secbox = tolist(IN[0])

#TransactionManager.Instance.EnsureInTransaction(doc)
#apply lineweight override to elements in an input list

OUT = []
max = []
min = []

for box in secbox:
	output = box.GetSectionBox()

	ftTomm = 304.8
	
	# "End" the transaction
	#TransactionManager.Instance.TransactionTaskDone()
	
	
	#Assign your output to the OUT variable
	max.append(Point.ByCoordinates(output.Max[0]*ftTomm, output.Max[1]*ftTomm, output.Max[2]*ftTomm))
	min.append(Point.ByCoordinates(output.Min[0]*ftTomm,output.Min[1]*ftTomm, output.Min[2]*ftTomm))
	
OUT = min, max
# ----------------------------------------
code_block = CodeBlock(seq=python_script) { seq[0]; seq[1]; }
byCorners = BoundingBox.ByCorners(min=code_block.out0, max=code_block.out1)
BoundingBox = Output(byCorners)
