# Dynamo custom node RIE.CircuitsFromPanel.dyf (Dynamo 1.3.3.4651)
# category: RIE.Power
# Retrieves all Circuits from input panel element

Panel = Input()
python_script = Python(IN[0]=Panel)
# ---------- python_script.python (34 lines) ----------
# @ Copyright - Designed by André Abotnes andre.abotnes@norconsult.com

import clr

# Import Revit API + APIUI
clr.AddReference('RevitAPI')
from Autodesk.Revit.DB import *
from Autodesk.Revit.DB.Electrical import *

OUT = []

def tolist(obj):
	if isinstance(obj, list):
		return UnwrapElement(obj)
	else:
		return [UnwrapElement(obj)]

panels = tolist(IN[0])
circuitsInPanel = []
circuits = []

for x in panels:
	circuits = []
	for y in x.MEPModel.ElectricalSystems:
		circuits.append(y)
	circuitsInPanel.append(circuits)
	
OUT = circuitsInPanel

#Assign your output to the OUT variable.
if len(OUT) == 1:
	OUT = OUT[0]
else:
	OUT = OUT 
# ----------------------------------------
Circuits = Output(python_script)
