# Dynamo custom node RIE.CreatePanelSchedule.dyf (Dynamo 1.3.3.4111)
# category: RIE.Views
# Creates PanelSchedule from input Panel elements. Uses default Template if no template is input.

Panel = Input()
Template = Input(Template : int = 0)
python_script = Python(IN[0]=Panel, IN[1]=Template)
# ---------- python_script.python (44 lines) ----------
import clr
clr.AddReference('RevitAPI')
from Autodesk.Revit.DB import *
from Autodesk.Revit.DB.Electrical import *
clr.AddReference('RevitServices')
import RevitServices
from RevitServices.Persistence import DocumentManager
from RevitServices.Transactions import TransactionManager

# Import ToDSType(bool) extension method
clr.AddReference("RevitNodes")
import Revit
clr.ImportExtensions(Revit.Elements)

doc = DocumentManager.Instance.CurrentDBDocument
uiapp = DocumentManager.Instance.CurrentUIApplication
app = uiapp.Application
#The inputs to this node will be stored as a list in the IN variables.

OUT = []

def tolist(obj):
	if isinstance(obj, list):
		return UnwrapElement(obj)
	else:
		return UnwrapElement([obj])

panels = tolist(IN[0])
templates = tolist(IN[1])

TransactionManager.Instance.EnsureInTransaction(doc)

if len(templates) > 1:
	for panel, temp in zip(panels,templates):
		OUT.append(PanelScheduleView.CreateInstanceView(doc, panel.Id, temp))
else:
	try:
		for panel in panels:
			OUT.append(PanelScheduleView.CreateInstanceView(doc, panel.Id, templates[0]))
	except:
		for panel in panels:
			OUT.append(PanelScheduleView.CreateInstanceView(doc, panel.Id))
			
TransactionManager.Instance.TransactionTaskDone()
# ----------------------------------------
PanelScheduleViews = Output(python_script)
