# Dynamo custom node RIE.ElementsIntersectingElement.dyf (Dynamo 1.3.3.4651)
# category: RIE.Elements
# Retrieves all elements intersecting with input element. Can be linked elements as well as local elements.

Elements = Input()
LinkOptional = Input(LinkOptional : var = null)
linkDocFromLink = Custom[RIE.LinkDocFromLink](LinkInstance=LinkOptional)  # Retrieves link Document element from link element.
python_script = Python(IN[0]=Elements, IN[1]=linkDocFromLink)
# ---------- python_script.python (39 lines) ----------
# RETRIEVED FROM EINAR RAKNES ON THE DYNAMOBIM.ORG FORUMS.

import clr
clr.AddReference('RevitAPI')
clr.AddReference('RevitNodes')
clr.AddReference('RevitServices')
import Revit
import RevitServices
from Autodesk.Revit.DB import *
from RevitServices.Persistence import DocumentManager
clr.ImportExtensions(Revit.Elements)
clr.ImportExtensions(Revit.GeometryConversion)

doc = DocumentManager.Instance.CurrentDBDocument

if IN[1] != None:
	doc = UnwrapElement(IN[1])

def tolist(obj):
	if isinstance(obj,list):
		return UnwrapElement(obj)
	else:
		return [UnwrapElement(obj)]

#Preparing input from dynamo to revit
els = tolist(IN[0])
OUT = []

for el in els:
	elems = []

	filter = ElementIntersectsElementFilter(el)
	
	collector = FilteredElementCollector(doc).WherePasses(filter)
	
	elems = [e.ToDSType(True) for e in collector]
	OUT.append(elems)
if len(OUT) == 1:
	OUT = OUT[0]
# ----------------------------------------
Elements_2 = Output(python_script)  # "Elements"
