# Dynamo custom node RIE.ElementsOfCategoryInBBox.dyf (Dynamo 1.3.3.4651)
# category: RIE.Elements
# Returns elements of input category contained by input boundingbox. Category needs to be representable as a builtincategory, but input from the category node.

BBox = Input()
Cat = Input()
buildinCategoryFromCategory = Custom[RIE.BuildinCategoryFromCategory](Cat=Cat@L1)  # Returns the OST builtincategory from input category.
OnlyInside = Input(OnlyInside : bool = false)
LinkOptional = Input(LinkOptional : var = null)
linkDocFromLink = Custom[RIE.LinkDocFromLink](LinkInstance=LinkOptional)  # Retrieves link Document element from link element.
python_script = Python(IN[0]=BBox, IN[1]=buildinCategoryFromCategory, IN[2]=OnlyInside, IN[3]=linkDocFromLink)
# ---------- python_script.python (47 lines) ----------
import clr
import System
clr.AddReference('RevitAPI')
clr.AddReference('RevitAPIUI')
clr.AddReference('RevitNodes')
clr.AddReference('RevitServices')
import Revit
import RevitServices
from Autodesk.Revit.DB import *
import Autodesk
from RevitServices.Persistence import DocumentManager
clr.ImportExtensions(Revit.Elements)
clr.ImportExtensions(Revit.GeometryConversion)
if IN[3] == None:
	doc = DocumentManager.Instance.CurrentDBDocument
else:
	doc = UnwrapElement(IN[3])

def tolist(obj):
	if isinstance(obj, list):
		return UnwrapElement(obj)
	else:
		return [UnwrapElement(obj)]

OUT = []

for bbx in tolist(IN[0]):
	elemsinside = []
	for builtinc in tolist(IN[1]):
		#Preparing input from dynamo to revit
		bb = bbx.ToRevitType()
		outline = Outline(bb.Min, bb.Max)
		#filter = BoundingBoxIntersectsFilter(outline)
		if IN[2] == False:
			filter = BoundingBoxIntersectsFilter(outline)
		else:
			filter = BoundingBoxIsInsideFilter(outline)
		
		collector = FilteredElementCollector(doc).WherePasses(filter).OfCategory(builtinc)
		elemsinside.append([e.ToDSType(True) for e in collector])
	if len(elemsinside) == 1:
		OUT.append(elemsinside[0])
	else:
		OUT.append(elemsinside)
	
if len(OUT) == 1:
	OUT = OUT[0]
# ----------------------------------------
Elements = Output(python_script)
