# Dynamo custom node RIE.ElementsOfCategoryInDocument.dyf (Dynamo 1.3.3.4651)
# category: RIE.Elements
# Returns all elements of category contained in input Autodesk.Revit.DB.Document

LinkInstance = Input()
linkDocFromLink = Custom[RIE.LinkDocFromLink](LinkInstance=LinkInstance)  # Retrieves link Document element from link element.
Cat = Input()
python_script = Python(IN[0]=linkDocFromLink, IN[1]=Cat)
# ---------- python_script.python (45 lines) ----------
import System
import clr
clr.AddReference('ProtoGeometry')
from Autodesk.DesignScript.Geometry import *
# Import ToDSType(bool) extension method
clr.AddReference("RevitNodes")
import Revit
clr.ImportExtensions(Revit.Elements)
# Import geometry conversion extension methods
clr.ImportExtensions(Revit.GeometryConversion)
# Import DocumentManager and TransactionManager
clr.AddReference("RevitServices")
import RevitServices
from RevitServices.Persistence import DocumentManager
from RevitServices.Transactions import TransactionManager
from System.Collections.Generic import *
# Import RevitAPI
clr.AddReference("RevitAPI")
import Autodesk
from Autodesk.Revit.DB import *

doc = DocumentManager.Instance.CurrentDBDocument
uiapp = DocumentManager.Instance.CurrentUIApplication
app = uiapp.Application
uidoc=DocumentManager.Instance.CurrentUIApplication.ActiveUIDocument

def tolist(obj):
	if isinstance(obj, list):
		return obj
	else:
		return [obj]

LinkDoc=tolist(IN[0])
cat = IN[1]
OUT = []

BuiltIn = System.Enum.ToObject(BuiltInCategory, cat.Id)

for link in LinkDoc:
	collector = FilteredElementCollector(link)
	filter = ElementCategoryFilter(BuiltIn)
	OUT.append(collector.WherePasses(filter).WhereElementIsNotElementType().ToElements())
	
if len(OUT) == 1:
	OUT = OUT[0]
# ----------------------------------------
Elems = Output(python_script)
