# Dynamo custom node RIE.ElementsOnSheet.dyf (Dynamo 1.3.4.6666)
# category: RIE.Views
# Input Sheet and retrieve all elements. This nodes get all elementIds by performing a deletion of the sheet, then undoing the transaction whilst retrieving all deleted elementIds, then retrieves all the elements that were restored.
# Therefore the sheets you input must be closed in the UI, or they cannot be deleted, hence this node will output null.

Sheets = Input()
elements_on_sheet_python = Python(IN[0]=Sheets)
# ---------- elements_on_sheet_python.python (55 lines) ----------
#Copyright(c) 2015, Konrad Sobon
# @arch_laboratory, http://archi-lab.net

import clr
clr.AddReference('ProtoGeometry')
from Autodesk.DesignScript.Geometry import *

# Import ToDSType(bool) extension method
clr.AddReference('RevitNodes')
import Revit
clr.ImportExtensions(Revit.Elements)

# Import DocumentManager and TransactionManager
clr.AddReference('RevitServices')
import RevitServices
from RevitServices.Persistence import DocumentManager
from RevitServices.Transactions import TransactionManager

# Import RevitAPI
clr.AddReference('RevitAPI')
import Autodesk
from Autodesk.Revit.DB import *

doc = DocumentManager.Instance.CurrentDBDocument

#The inputs to this node will be stored as a list in the IN variable.
dataEnteringNode = IN

elements = []
for i in IN[0]:
	elements.append(UnwrapElement(i))

TransactionManager.Instance.EnsureInTransaction(doc)

schName, schId, ids = [], [], []
for i in elements:
	trans = SubTransaction(doc)
	trans.Start()
	ids.append(doc.Delete(i.Id))
	trans.RollBack()

		
TransactionManager.Instance.TransactionTaskDone()



elementsOnSheet = []
elementsOnSheet1 = []
for i in ids:
	for j in i:
		if doc.GetElement(j) != None:
			elementsOnSheet.append(doc.GetElement(j).GetType())
			elementsOnSheet1.append(doc.GetElement(j))

OUT = elementsOnSheet1
# ----------------------------------------
Elements = Output(elements_on_sheet_python)
