# Dynamo custom node RIE.FilterOutBusyElements.dyf (Dynamo 1.3.2.2480)
# category: RIE.Elements
# Filters out elements that are borrowed by other localfile users.

Elements = Input()
flatten = Flatten(Elements)
code_block = CodeBlock { ""; }
element_owner = Python(IN[0]=flatten)
# ---------- element_owner.python (37 lines) ----------
# Copyright(c) 2017, Dimitar Venkov
# @5devene, dimitar.ven@gmail.com
# www.badmonkeys.net

import clr
import System

clr.AddReference("RevitNodes")
import Revit
clr.ImportExtensions(Revit.Elements)
clr.ImportExtensions(Revit.GeometryConversion)

clr.AddReference('RevitServices')
from RevitServices.Persistence import DocumentManager
from RevitServices.Transactions import TransactionManager
doc = DocumentManager.Instance.CurrentDBDocument

clr.AddReference('System')
from System.Collections.Generic import List

clr.AddReference("RevitAPI")
from Autodesk.Revit.DB import *


def tolist(obj1):
	if hasattr(obj1,"__iter__"): return obj1
	else: return [obj1]

elemelons = UnwrapElement(tolist(IN[0]))
owner = []

OUT = []

for _ in elemelons:
	owner.append(WorksharingUtils.GetWorksharingTooltipInfo(doc, _.Id).Owner)

OUT = owner
# ----------------------------------------
eq = code_block == element_owner
current = Document.Current()
filePath = Document.FilePath(current)
usernameFetcher = Python(IN[0]=filePath)
# ---------- usernameFetcher.python (20 lines) ----------
import clr
clr.AddReference('ProtoGeometry')
from Autodesk.DesignScript.Geometry import *

clr.AddReference('RevitServices')
import RevitServices
from RevitServices.Persistence import DocumentManager
from RevitServices.Transactions import TransactionManager
from System.Collections.Generic import *

clr.AddReference('RevitAPI')
import Autodesk
from Autodesk.Revit.DB import *

doc = DocumentManager.Instance.CurrentDBDocument
uiapp = DocumentManager.Instance.CurrentUIApplication
app = uiapp.Application


OUT = BasicFileInfo.Extract(IN[0]).Username
# ----------------------------------------
eq_2 = element_owner == usernameFetcher
xor_gate = Python(IN[0]=eq, IN[1]=eq_2)
# ---------- xor_gate.python (7 lines) ----------
OUT = []

for i in range(0, len(IN[0])):
	if IN[0][i] == True or IN[1][i] == True:
		OUT.append(True)
	else:
		OUT.append(False)
# ----------------------------------------
filterByBoolMask = List.FilterByBoolMask(list=flatten, mask=xor_gate)
Elements_2 = Output(filterByBoolMask.in)  # "Elements"
BusyElements = Output(filterByBoolMask.out)
