# Dynamo custom node RIE.GetCategoriesFromString.dyf (Dynamo 1.3.3.4651)
# category: RIE.Elements
# Returns Categories by Name

python_script = Python()
# ---------- python_script.python (21 lines) ----------
import clr
clr.AddReference('RevitAPI')
from Autodesk.Revit.DB import *

clr.AddReference("RevitNodes")
import Revit
clr.ImportExtensions(Revit.Elements)
clr.ImportExtensions(Revit.GeometryConversion)

clr.AddReference("RevitServices")
import RevitServices
from RevitServices.Persistence import DocumentManager
from RevitServices.Transactions import TransactionManager

doc = DocumentManager.Instance.CurrentDBDocument
categories = doc.Settings.Categories

OUT = []

for c in categories:
	OUT.append(Revit.Elements.Category.ById(c.Id.IntegerValue))
# ----------------------------------------
string_from_object = FromObject(python_script)
String = Input()
eq = string_from_object == String@L1
code_block = CodeBlock { true; }
indexOf = Custom[IndexOf](List=eq@L2, Item=code_block)  # Returns a sublistlist with all indexes for each item.
flatten = Flatten(indexOf)
getItemAtIndex = List.GetItemAtIndex(list=python_script, index=flatten)
code_block_2 = CodeBlock { null; }
isEmpty = List.IsEmpty(indexOf@L2)
indexOf_2 = Custom[IndexOf](List=isEmpty, Item=code_block)
flatten_2 = Flatten(indexOf_2)
count = Count(flatten_2)
ofRepeatedItem = List.OfRepeatedItem(item=code_block_2, amount=count)
insertItemAtIndex = Custom[InsertItemAtIndex](List=getItemAtIndex, Item=ofRepeatedItem, Index=flatten_2)  # Inserts Items into list at given index
Category = Output(insertItemAtIndex)
