# Dynamo custom node RIE.GetCircuitFromPanelScheduleView.dyf (Dynamo 1.3.2.2480)
# category: RIE.Power
# Input PanelScheduleView Element, and input integervalue of circuit.

PanelScheduleView = Input()
Rows = Input()
Col = Input(Col : int = 1)
python_script = Python(IN[0]=PanelScheduleView, IN[1]=Rows, IN[2]=Col)
# ---------- python_script.python (29 lines) ----------
import clr
clr.AddReference('RevitAPI')
from Autodesk.Revit.DB import *
clr.AddReference('RevitServices')
import RevitServices
from RevitServices.Persistence import DocumentManager
from RevitServices.Transactions import TransactionManager

doc = DocumentManager.Instance.CurrentDBDocument
uiapp = DocumentManager.Instance.CurrentUIApplication
app = uiapp.Application
#The inputs to this node will be stored as a list in the IN variables.

def tolist(obj):
	if isinstance(obj, list):
		return obj
	else:
		return [obj]

PS = UnwrapElement(IN[0])
nFromRow = tolist(IN[1])
Col = IN[2]

circuits = []
for n in nFromRow:
	circuits.append(PS.GetCircuitByCell(n + 1, Col))

		
OUT = circuits
# ----------------------------------------
Circuits = Output(python_script)
