# Dynamo custom node RIE.GetOpenedAndLinkedDocuments.dyf (Dynamo 1.3.3.4651)
# category: RIE.Elements
# Returns all opened and linked revit documents

Refresh = Input(Refresh : bool = true)
python_script = Python(IN[0]=Refresh)
# ---------- python_script.python (23 lines) ----------
import clr
clr.AddReference('RevitAPI')
from Autodesk.Revit.ApplicationServices import*

clr.AddReference("RevitServices")
import RevitServices
from RevitServices.Persistence import DocumentManager

# Import ToDSType(bool) extension method
clr.AddReference("RevitNodes")
import Revit
clr.ImportExtensions(Revit.Elements)

uiapp = DocumentManager.Instance.CurrentUIApplication
app = uiapp.Application

docs = app.Documents
titles = []
elems = []
for i in docs:
	t1 = i.Title
	titles.append(t1)
OUT = docs,titles
# ----------------------------------------
code_block = CodeBlock(_=python_script) { _[0]; _[1]; }
Doc = Output(code_block.out0)
Names = Output(code_block.out1)
