# Dynamo custom node RIE.GetPanelAndEquipmentFromCircuit.dyf (Dynamo 1.3.3.4651)
# category: RIE.Power
# Gets panel circuit is connected to, and Elements connected to the circuit.

Circuits = Input()
python_script = Python(IN[0]=Circuits)
# ---------- python_script.python (73 lines) ----------
# @ Copyright - Designed by André Abotnes andre.abotnes@norconsult.com
import sys
#pyt_path = r"C:\Program Files (x86)\IronPython 2.7\DLLs"
#sys.path.append(pyt_path)
import clr

#clr.AddReference('IronPython.SQLite.dll')
pyt_path = r"C:\Program Files (x86)\IronPython 2.7\Lib"
sys.path.append(pyt_path)
#import sqlite3

# Import ToDSType(bool) extension method
clr.AddReference('RevitNodes')
import Revit
clr.ImportExtensions(Revit.GeometryConversion)
clr.ImportExtensions(Revit.Elements)

# Import DocumentManager and TransactionManager
clr.AddReference('RevitServices')
import RevitServices
from RevitServices.Persistence import DocumentManager
from RevitServices.Transactions import TransactionManager

doc = DocumentManager.Instance.CurrentDBDocument
uidoc = DocumentManager.Instance.CurrentUIApplication.ActiveUIDocument
app = DocumentManager.Instance.CurrentUIApplication.Application

# Import List ( ICollection(ElementId) = List[ElementId]() )
clr.AddReference('System')
from System.Collections.Generic import List

# Import Revit API + APIUI
clr.AddReference('RevitAPI')
from Autodesk.Revit.DB import *
from Autodesk.Revit.DB.Electrical import *

clr.AddReference('RevitAPIUI')
from Autodesk.Revit.UI import *

OUT = []

def tolist(obj):
	if isinstance(obj, list):
		return UnwrapElement(obj)
	else:
		return [UnwrapElement(obj)]

# Start Transaction
# TransactionManager.Instance.EnsureInTransaction(doc)

# End Transaction
# TransactionManager.Instance.TransactionTaskDone()

systems = tolist(IN[0])
panels = []
elements = []

for x in systems:
	panels.append(x.BaseEquipment)
	sublist = []
	try:
		elementset = x.Elements
		for x in elementset:
			sublist.append(x)
	except:
		if x.IsEmpty:
			sublist.append(x.Category.Name)
		else:
			sublist.append("Failed")
	elements.append(sublist)

#Assign your output to the OUT variable.
OUT = panels, elements
# ----------------------------------------
code_block = CodeBlock(a=python_script) { a[0]; a[1]; }
Panels = Output(code_block.out0)
Elements = Output(code_block.out1)
