# Dynamo custom node RIE.GraphicOverrideElementsInViews.dyf (Dynamo 1.3.4.6666)
# category: RIE.Views
# Overrides elements in views with input color for both lines and fill. Requires you to have a fill pattern named "Solid fill"

elements = Input()
views = Input()
color = Input()
red = Color.Red(color)
green = Color.Green(color)
blue = Color.Blue(color)
convert_dyn_color_to_rev_color = Python(IN[0]=red, IN[1]=green, IN[2]=blue)
# ---------- convert_dyn_color_to_rev_color.python (21 lines) ----------
import clr
clr.AddReference('ProtoGeometry')
from Autodesk.DesignScript.Geometry import *

clr.AddReference('RevitAPI')
from Autodesk.Revit.DB import *

clr.AddReference("RevitNodes")
import Revit
clr.ImportExtensions(Revit.Elements)

clr.AddReference("RevitServices")
import RevitServices
from RevitServices.Persistence import DocumentManager
from RevitServices.Transactions import TransactionManager

doc = DocumentManager.Instance.CurrentDBDocument

color = Color(IN[0],IN[1],IN[2])

OUT = color
# ----------------------------------------
AlsoOverrideLines = Input(AlsoOverrideLines: bool = false)
FillPatternName = Input(FillPatternName : var = null)
override_graphics_of_elements_in = Python(IN[0]=elements, IN[1]=views, IN[2]=convert_dyn_color_to_rev_color, IN[3]=AlsoOverrideLines, IN[4]=FillPatternName)  # "Override graphics of elements in views"
# ---------- override_graphics_of_elements_in.python (60 lines) ----------
import clr
clr.AddReference('ProtoGeometry')
from Autodesk.DesignScript.Geometry import *

clr.AddReference('RevitAPI')
from Autodesk.Revit.DB import *

clr.AddReference("RevitNodes")
import Revit
clr.ImportExtensions(Revit.Elements)

# Import DocumentManager
clr.AddReference("RevitServices")
import RevitServices
from RevitServices.Persistence import DocumentManager
from RevitServices.Transactions import TransactionManager

doc = DocumentManager.Instance.CurrentDBDocument
uiapp = DocumentManager.Instance.CurrentUIApplication
app = uiapp.Application

def tolist(obj):
	if isinstance(obj, list):
		return UnwrapElement(obj)
	else:
		return [UnwrapElement(obj)]

elements = tolist(IN[0])
views = tolist(IN[1])
color = IN[2]
target = FillPatternTarget.Model
if IN[4] == None:
	fillname = 'Solid fill'
else:	
	fillname = IN[4]
drafting = "x"

try:
	errorReport = None
	if drafting:
		fillPatTarget = FillPatternTarget.Drafting
	else:
		fillPatTarget = FillPatternTarget.Model
	fillPat = FillPatternElement.GetFillPatternElementByName(doc, fillPatTarget, fillname)
except:
	drafting = "y"
	
opt = OverrideGraphicSettings()
if IN[3] == True:
	opt.SetProjectionLineColor(color)
opt.SetProjectionFillColor(color)
opt.SetProjectionFillPatternId(fillPat.Id)

TransactionManager.Instance.EnsureInTransaction(doc)
for view in views:
	for element in elements:
		view.SetElementOverrides(element.Id, opt)
TransactionManager.Instance.TransactionTaskDone()

OUT = elements
# ----------------------------------------
elements_2 = Output(override_graphics_of_elements_in)  # "elements"
