# Dynamo custom node RIE.LinkedFamilyType.dyf (Dynamo 1.3.3.4651)
# category: RIE.Elements
# Returns FamilyType for linked elements.

LinkedElement = Input()
python_script = Python(IN[0]=LinkedElement)
# ---------- python_script.python (16 lines) ----------
import clr
clr.AddReference('RevitAPI')
from Autodesk.Revit.DB import *

def tolist(obj):
	if isinstance(obj, list):
		return UnwrapElement(obj)
	else:
		return [UnwrapElement(obj)]

types = []

items = tolist(IN[0])
for item in items:
	types.append(item.Document.GetElement(item.GetTypeId()))
OUT = types
# ----------------------------------------
Type = Output(python_script)
