# Dynamo custom node RIE.Math.MRound.dyf (Dynamo 1.3.2.2480)
# category: RIE.List
# Rounds given numbers to nearest input multiple

Number = Input()
code_block = CodeBlock(Number=Number) { Number; }
round = Math.Round(code_block)
Multiple = Input()
code_block_2 = CodeBlock(Multiple=Multiple) { Multiple; }
div = round / code_block_2
round_2 = Math.Round(div)
mul = round_2 * code_block_2
Rounded = Output(mul)
