# Dynamo custom node RIE.MoveCircuitToFirstOpen.dyf (Dynamo 1.3.2.2480)
# category: RIE.Power
# Moves input circuit to first open in input starting series.

PanelScheduleView = Input()
FromRow = Input()
ToFirstOpenInSeries = Input()
python_script = Python(IN[0]=PanelScheduleView, IN[1]=FromRow, IN[2]=ToFirstOpenInSeries)
# ---------- python_script.python (45 lines) ----------
import clr
clr.AddReference('RevitAPI')
from Autodesk.Revit.DB import *
clr.AddReference('RevitServices')
import RevitServices
from RevitServices.Persistence import DocumentManager
from RevitServices.Transactions import TransactionManager

doc = DocumentManager.Instance.CurrentDBDocument
uiapp = DocumentManager.Instance.CurrentUIApplication
app = uiapp.Application
#The inputs to this node will be stored as a list in the IN variables.

def tolist(obj):
	if isinstance(obj, list):
		return obj
	else:
		return [obj]
		
if isinstance(IN[0],list):
	PS = UnwrapElement(IN[0][0])
else:
	PS = UnwrapElement(IN[0])
nMovingRow = tolist(IN[1])
StartSeries = IN[2]
Col = 1

TransactionManager.Instance.EnsureInTransaction(doc)

for n in range(0, len(nMovingRow)):
	counter = 0
	check = False
	while check == False:
		if PS.CanMoveSlotTo(nMovingRow[n]+1,Col,StartSeries+counter+1,Col):
			PS.MoveSlotTo(nMovingRow[n]+1,Col,StartSeries+counter+1,Col)
			check = True
			break
		else:
			counter += 1
		if counter > 300:
			break
			
TransactionManager.Instance.TransactionTaskDone()
		
OUT = PS
# ----------------------------------------
PanelScheduleView_2 = Output(python_script)  # "PanelScheduleView"
