# Dynamo custom node RIE.ReplaceItemsAtIndices.dyf (Dynamo 1.3.2.2480)
# category: RIE.List
# Replaces items at indices with input value. One value for each index needed.

List = Input()
Indices = Input()
Item = Input()
python_script = Python(IN[0]=List, IN[1]=Indices, IN[2]=Item)
# ---------- python_script.python (18 lines) ----------
import clr
clr.AddReference('ProtoGeometry')
from Autodesk.DesignScript.Geometry import *
#The inputs to this node will be stored as a list in the IN variables.

def tolist(obj):
	if isinstance(obj, list):
		return UnwrapElement(obj)
	else:
		return [UnwrapElement(obj)]

OUT = []

for i in range(0, len(tolist(IN[0]))):
	if i in tolist(IN[1]):
		OUT.append(IN[2])
	else:
		OUT.append(IN[0][i])
# ----------------------------------------
List_2 = Output(python_script)  # "List"
