# Dynamo custom node RIE.SheetsContainingRevision.dyf (Dynamo 1.3.4.6666)
# category: RIE.Revisions
# Returns all sheets in the model that contains the input revision

categories = Categories("Sheets")
all_elements_of_category = ElementsOfCategory(categories)
revisionsOnSheet = Custom[RIE.RevisionsOnSheet](Sheet=all_elements_of_category)  # Returns Revisions that are placed on a sheet.
Revision = Input()
containsItem = List.ContainsItem(list=revisionsOnSheet@L2, item=Revision)
transpose = List.Transpose(containsItem)
filterByBoolMask = List.FilterByBoolMask(list=all_elements_of_category, mask=transpose@L2)
python_script = Python(IN[0]=filterByBoolMask.in)
# ---------- python_script.python (11 lines) ----------
import clr
clr.AddReference('ProtoGeometry')
from Autodesk.DesignScript.Geometry import *
#The inputs to this node will be stored as a list in the IN variables.
dataEnteringNode = IN

#Assign your output to the OUT variable.
if len(IN[0]) > 1:
	OUT = IN[0]
else:
	OUT = IN[0][0]
# ----------------------------------------
Sheets = Output(python_script)
