# Dynamo custom node RIE.ViewType.dyf (Dynamo 1.3.2.2480)
# category: RIE.Views
# Outputs the type of view input to the node

Views = Input()
python_script = Python(IN[0]=Views)
# ---------- python_script.python (19 lines) ----------
import clr
clr.AddReference('ProtoGeometry')
from Autodesk.DesignScript.Geometry import *

clr.AddReference('RevitAPI')
from Autodesk.Revit.DB import *

def tolist(obj):
	if isinstance(obj, list):
		return UnwrapElement(obj)
	else:
		return [UnwrapElement(obj)]
		
views = tolist(IN[0])

OUT = []

for view in views:
	OUT.append(view.ViewType)
# ----------------------------------------
ViewTypes = Output(python_script)
