# Dynamo custom node RIE.WorksharingInfoFromLink.dyf (Dynamo 1.3.2.2480)
# category: RIE.Elements
# Gets worksharing info from input link instance and elementset

Elems = Input()
LinkInstance = Input()
python_script = Python(IN[0]=Elems, IN[1]=LinkInstance)
# ---------- python_script.python (39 lines) ----------
# Copyright(c) 2017, Dimitar Venkov
# @5devene, dimitar.ven@gmail.com
# www.badmonkeys.net

import clr
import System

clr.AddReference("RevitNodes")
import Revit
clr.ImportExtensions(Revit.Elements)
clr.ImportExtensions(Revit.GeometryConversion)

clr.AddReference('RevitServices')
from RevitServices.Persistence import DocumentManager
from RevitServices.Transactions import TransactionManager
doc = DocumentManager.Instance.CurrentDBDocument

clr.AddReference('System')
from System.Collections.Generic import List

clr.AddReference("RevitAPI")
from Autodesk.Revit.DB import *


def tolist(obj1):
	if hasattr(obj1,"__iter__"): return obj1
	else: return [obj1]

elemelons = UnwrapElement(tolist(IN[0]))
link = UnwrapElement(IN[1]).GetLinkDocument()
creator = []
lastchangedby = []
OUT = []

for _ in elemelons:
	creator.append(WorksharingUtils.GetWorksharingTooltipInfo(link, _.Id).Creator)
	lastchangedby.append(WorksharingUtils.GetWorksharingTooltipInfo(link, _.Id).LastChangedBy)

OUT = creator, lastchangedby
# ----------------------------------------
code_block = CodeBlock(a=python_script) { a[0]; a[1]; }
CreatedBy = Output(code_block.out0)
ModifiedBy = Output(code_block.out1)
